# Dynamo graph Automate Clash Detection.dyn (Dynamo 2.13.1.3887)

# group: MEP vs. STRUCTURE
file_path = Filename("Naviswork Files\MEP vs. STRUCTURE.xml")
python_script = Python(IN[0]=file_path)  # CPython3
# ---------- python_script.python (21 lines) ----------
import xml.etree.ElementTree as ET

file_path = IN[0]
tree = ET.parse(file_path)
root = tree.getroot()

clash_ids, element1_ids, element2_ids, clash_locations = [], [], [], []

for clash in root.findall(".//clashresult"):
    clash_id = clash.get("name")
    clash_ids.append(clash_id)

    clashpoint = clash.find("clashpoint/pos3f")
    x, y, z = float(clashpoint.get("x")), float(clashpoint.get("y")), float(clashpoint.get("z"))
    clash_locations.append([x, y, z])

    clashobjects = clash.findall("clashobjects/clashobject")
    element1_ids.append(clashobjects[0].find("objectattribute/value").text)
    element2_ids.append(clashobjects[1].find("objectattribute/value").text)

OUT = clash_ids, element1_ids, element2_ids, clash_locations
# ----------------------------------------
code_block = CodeBlock { 0; 1; 2; 3; }
getItemAtIndex = List.GetItemAtIndex(list=python_script, index=code_block.out0)
getItemAtIndex_2 = List.GetItemAtIndex(list=python_script, index=code_block.out1)
getItemAtIndex_3 = List.GetItemAtIndex(list=python_script, index=code_block.out2)
getItemAtIndex_4 = List.GetItemAtIndex(list=python_script, index=code_block.out3)

# group: MEP vs. ARCHITECTURE
file_path_2 = Filename("Naviswork Files\MEP & ARCHITECTURE.xml")
python_script_2 = Python(IN[0]=file_path_2)  # CPython3; same code as python_script
code_block_2 = CodeBlock { 0; 1; 2; 3; }
getItemAtIndex_5 = List.GetItemAtIndex(list=python_script_2, index=code_block_2.out0)
getItemAtIndex_6 = List.GetItemAtIndex(list=python_script_2, index=code_block_2.out1)
getItemAtIndex_7 = List.GetItemAtIndex(list=python_script_2, index=code_block_2.out2)
getItemAtIndex_8 = List.GetItemAtIndex(list=python_script_2, index=code_block_2.out3)

# group: All Clashes List
join = List.Join(list0=getItemAtIndex, list1=getItemAtIndex_5)
join_2 = List.Join(list0=getItemAtIndex_2, list1=getItemAtIndex_6)
join_3 = List.Join(list0=getItemAtIndex_3, list1=getItemAtIndex_7)
join_4 = List.Join(list0=getItemAtIndex_4, list1=getItemAtIndex_8)
list_create = List.Create(item0=join, item1=join_2, item2=join_3, item3=join_4)
transpose = List.Transpose(lists=list_create)

# group: High Priority
code_block_3 = CodeBlock { "13"; "71"; }
startsWith = String.StartsWith(string=join_2, searchFor=code_block_3.out0)
startsWith_2 = String.StartsWith(string=join_2, searchFor=code_block_3.out1)
or_ = startsWith || startsWith_2
code_block_4 = CodeBlock { "42"; }
startsWith_3 = String.StartsWith(string=join_3, searchFor=code_block_4)
code_block_5 = CodeBlock(A=or_, B=startsWith_3) { A && B; }
filterByBoolMask = List.FilterByBoolMask(list=transpose, mask=code_block_5)

# group: Medium Priority
code_block_6 = CodeBlock { "13"; "29"; }
startsWith_4 = String.StartsWith(string=join_2, searchFor=code_block_6.out0)
startsWith_5 = String.StartsWith(string=join_2, searchFor=code_block_6.out1)
or_2 = startsWith_4 || startsWith_5
code_block_7 = CodeBlock { "30"; "33"; }
startsWith_6 = String.StartsWith(string=join_3, searchFor=code_block_7.out0)
startsWith_7 = String.StartsWith(string=join_3, searchFor=code_block_7.out1)
or_3 = startsWith_6 || startsWith_7
code_block_8 = CodeBlock(A=or_2, B=or_3) { A && B; }
filterByBoolMask_2 = List.FilterByBoolMask(list=transpose, mask=code_block_8)

# group: Clash Marker's Family
code_block_9 = CodeBlock { 3; }
getItemAtIndex_9 = List.GetItemAtIndex(index=code_block_9)  # unwired: list
map = List.Map(list=filterByBoolMask.in, function=getItemAtIndex_9)
code_block_10 = CodeBlock { 3; }
getItemAtIndex_10 = List.GetItemAtIndex(index=code_block_10)  # unwired: list
map_2 = List.Map(list=filterByBoolMask_2.in, function=getItemAtIndex_10)

# group: X
code_block_11 = CodeBlock { 0; }
getItemAtIndex_11 = List.GetItemAtIndex(index=code_block_11)  # unwired: list
map_3 = List.Map(list=map, function=getItemAtIndex_11)

# group: Y
code_block_12 = CodeBlock { 1; }
getItemAtIndex_12 = List.GetItemAtIndex(index=code_block_12)  # unwired: list
map_4 = List.Map(list=map, function=getItemAtIndex_12)

# group: Z
code_block_13 = CodeBlock { 2; }
getItemAtIndex_13 = List.GetItemAtIndex(index=code_block_13)  # unwired: list
map_5 = List.Map(list=map, function=getItemAtIndex_13)

# group: Create Clash Mark(High Priority)
family_types = FamilyTypes("Family2:Family2")
byCoordinates = Point.ByCoordinates(x=map_3, y=map_4, z=map_5)
byPoint = FamilyInstance.ByPoint(familyType=family_types, point=byCoordinates)
code_block_14 = CodeBlock { "Priority"; "High"; }
setParameterByName = Element.SetParameterByName(element=byPoint, parameterName=code_block_14.out0, value=code_block_14.out1)

# group: X
code_block_15 = CodeBlock { 0; }
getItemAtIndex_14 = List.GetItemAtIndex(index=code_block_15)  # unwired: list
map_6 = List.Map(list=map_2, function=getItemAtIndex_14)

# group: Y
code_block_16 = CodeBlock { 1; }
getItemAtIndex_15 = List.GetItemAtIndex(index=code_block_16)  # unwired: list
map_7 = List.Map(list=map_2, function=getItemAtIndex_15)

# group: Z
code_block_17 = CodeBlock { 2; }
getItemAtIndex_16 = List.GetItemAtIndex(index=code_block_17)  # unwired: list
map_8 = List.Map(list=map_2, function=getItemAtIndex_16)

# group: Create Clash Mark(Medium Priority)
family_types_2 = FamilyTypes("Family2:Family2")
byCoordinates_2 = Point.ByCoordinates(x=map_6, y=map_7, z=map_8)
byPoint_2 = FamilyInstance.ByPoint(familyType=family_types_2, point=byCoordinates_2)
code_block_18 = CodeBlock { "Priority"; "Medium"; }
setParameterByName_2 = Element.SetParameterByName(element=byPoint_2, parameterName=code_block_18.out0, value=code_block_18.out1)

# group: Sphere Resolution
categories = Categories("OST_MechanicalEquipment")
all_elements_of_category = ElementsOfCategory(Category=categories)
code_block_19 = CodeBlock { 1; }
dropItems = List.DropItems(list=all_elements_of_category, amount=code_block_19)
code_block_20 = CodeBlock { "Material"; }
code_block_21 = CodeBlock { ["Medium_Unresolved","Medium_Resolved","High_Unresolved","High_Resolved"]; }
byName = Material.ByName(name=code_block_21)
byKeysValues = DesignScript.Builtin.Dictionary.ByKeysValues(keys=code_block_21, values=byName)
code_block_22 = CodeBlock { "Priority"; "ResolutionStatus"; }
getParameterValueByName = Element.GetParameterValueByName(element=dropItems, parameterName=code_block_22.out0)
getParameterValueByName_2 = Element.GetParameterValueByName(element=dropItems, parameterName=code_block_22.out1)
code_block_23 = CodeBlock(Priority=getParameterValueByName, ResolutionStatus=getParameterValueByName_2) { Priority + "_" + ResolutionStatus; }
valueAtKey = DesignScript.Builtin.Dictionary.ValueAtKey(dictionary=byKeysValues, key=code_block_23)
setParameterByName_3 = Element.SetParameterByName(element=dropItems, parameterName=code_block_20, value=valueAtKey)

# group: Sphere Text
categories_2 = Categories("OST_MechanicalEquipment")
all_elements_of_category_2 = ElementsOfCategory(Category=categories_2)
python_script_3 = Python(IN[0]=all_elements_of_category_2)  # CPython3
# ---------- python_script_3.python (8 lines) ----------
# Input: Original list from Dynamo
original_list = IN[0]

# Remove the 0 index
filtered_list = original_list[1:]

# Output the new list
OUT = filtered_list
# ----------------------------------------
code_block_24 = CodeBlock { "Clash Label"; }
code_block_25 = CodeBlock { "Clash ID"; "Priority"; "ResolutionStatus"; }
getParameterValueByName_3 = Element.GetParameterValueByName(element=python_script_3, parameterName=code_block_25.out0)
getParameterValueByName_4 = Element.GetParameterValueByName(element=python_script_3, parameterName=code_block_25.out1)
getParameterValueByName_5 = Element.GetParameterValueByName(element=python_script_3, parameterName=code_block_25.out2)
code_block_26 = CodeBlock(ClashID=getParameterValueByName_3, Priority=getParameterValueByName_4, ResolutionStatus=getParameterValueByName_5) { "Clash ID: " + ClashID + "\nPriority: " + Priority + "\nStatus: " + ResolutionStatus; }
setParameterByName_4 = Element.SetParameterByName(element=python_script_3, parameterName=code_block_24, value=code_block_26)
